# Grasshopper definition RDGrid.gh (Grasshopper 1.0.7)

file_path = FilePath("G:\Mi unidad\Barcelona MPDA\Universidad\2nd Semester\Algorithmics in Techonology\AT AP\GitHub\MPDA_AT.AP\RDGrid.py")
number_slider = Slider(1, range=0..10)
number_slider_2 = Slider(69, range=0..200)
number_slider_3 = Slider(10, range=0..200)
read_file = ReadFile(File=file_path, PerLineParse=False)
ghpython_script = GhPythonScript(
    Code=read_file,
    Width=number_slider_3,
    Heigth=number_slider_3,
    Iter=Slider(0, range=0..1000),
    XSize=number_slider,
    YSize=number_slider,
    Amp=Slider(2, range=0..10))  # -> Out, Grid, Curves, Srf, Mesh
panel = Panel(ghpython_script.Out)
point = Point(ghpython_script.Grid)
curve = Curve(ghpython_script.Curves)
surface = Surface(ghpython_script.Srf)
mesh = Mesh(ghpython_script.Mesh)
